vi "File Download or Upload.gviweb"   [LabVIEW NXG 3.1.0]
panel controls:
  "Upload": bool
  "Download": bool
  "Download Data": string[][] = [["1", "27"], ["2", "45"], ["3", "10"], ["4", "75"]]
  "File Name": string = "File.csv"
panel indicators:
  "File Text": string
uses:
  UploadLibrary::subVI::Dowload a File.gviweb
  UploadLibrary::subVI::Upload a File.gviweb
diagram:
  while {
    event {
      on "Download" Value changed {
        call "Dowload a File.gviweb"(File Name=$"File Name", Download Data=$"Download Data")
      }
      on "Upload" Value changed { }
    }
    stop if FALSE
  }
  while {
    # Upload a file cannot be used in an event structure. It blocks until one file is selected and loaded.
    Wait(time to wait=10)
    call "Upload a File.gviweb"(Selector=".my-upload-button") -> (FileText=w1)
    $"File Text" <- w1
    stop if FALSE
  }
